# Grasshopper definition vultureDefinition.gh (Grasshopper 0.9.72)
# plug-ins: VultureGH

number_slider = Slider(10, range=0..10)
ellipse = Ellipse(Plane=PlaneXY(0, 0, 0), Radius1=Slider(10, range=0..10), Radius2=Slider(5.89, range=0..10))  # -> Ellipse, Focus1, Focus2
series = Series(Start=0, Step=Slider(5, range=0..10), Count=number_slider)
Z = UnitZ(Factor=series)
mbox = MeshBox(Base={Plane=PlaneXY(0, 0, 0), X=Domain(-10, 10), Y=Domain(-10, 10), Z=Domain(-10, 10)}, XCount=1, YCount=1, ZCount=1)
series_2 = Series(Start=0, Step=Slider(0.78, range=0..1), Count=number_slider)
move = Move(Geometry=ellipse.Ellipse, Motion=Z)  # -> Geometry, Transform
rotate = Rotate(Geometry=mbox, Angle=Slider(10, range=0..10), Plane=PlaneXY(0, 0, 0))  # -> Geometry, Transform
X = UnitX(Factor=Slider(48, range=0..100))
brep = Brep()
rotate_2 = Rotate(Geometry=move.Geometry, Angle=series_2, Plane=PlaneXY(0, 0, 0))  # -> Geometry, Transform
move_2 = Move(Geometry=rotate.Geometry, Motion=X)  # -> Geometry, Transform
loft = Loft(
    Curves=rotate_2.Geometry,
    Options={Adjust=False, Closed=False, LoftEnds=0, LoftSimp=0, LoftType=0, Rebuild=10, Refit=0.01})
cap = CapHoles(Brep=loft)
tri = Triangulate(Mesh=cap)  # -> Mesh, Count
tri_2 = Triangulate(Mesh=move_2.Geometry)  # -> Mesh, Count
demesh = DeconstructMesh(Mesh=tri.Mesh)  # -> Vertices, Faces, Colours, Normals
demesh_2 = DeconstructMesh(Mesh=tri_2.Mesh)  # -> Vertices, Faces, Colours, Normals
pt = Point(Point(-30.44911921, -23.20975541, 42.77367014))
pt_2 = Point([Point(-1, -214.1, 52.3), Point(7.9, 6.3, 19.8)])
lng = ListLength(List=demesh.Vertices)
lng_2 = ListLength(List=demesh.Faces)
lng_3 = ListLength(List=demesh_2.Vertices)
lng_4 = ListLength(List=demesh_2.Faces)
panel = Panel([lng_3, lng_4])
panel_2 = Panel([lng, lng_2])
vulture = VultureGH(
    Mesh=flatten([cap, move_2.Geometry]),
    Lights=pt,
    Cameras=flatten(pt_2),
    WriteFile=False,
    Path="C:\Dropbox\# WORK\VVVVulture\Sample File\")
